# Grasshopper definition BigAntenna.gh (Grasshopper 0.9.64)

number_slider = Slider(0.5, range=0..1, expression="pi/2")
number_slider_2 = Slider(7, range=0..10, expression="2*pi")
tran_line_length = Slider(17.5, range=14..20)
radius = Slider(76.8875, range=0..100)
number_of_vertices = Slider(16, range=0..100)
# Central Angle
division = Division(A=number_slider_2, B=number_of_vertices)
axb = Multiplication(A=division, B=Slider(1.5, range=0..10))
addition = Addition(A=tran_line_length, B=radius)
# Theta
subtraction = Subtraction(A=number_slider, B=axb)
panel = Panel(subtraction)
addition_2 = Addition(A=Slider(45, range=0..100), B=addition)
cosine = Cosine(Value=subtraction)
sine = Sine(Value=subtraction)
panel_2 = Panel(addition_2)
axb_2 = Multiplication(A=addition_2, B=cosine)
axb_3 = Multiplication(A=addition_2, B=sine)
panel_3 = Panel(axb_3)
panel_4 = Panel(axb_2)
construct_point = ConstructPoint(XCoordinate=panel_4, YCoordinate=panel_3, ZCoordinate=0)
# First 16-gon
polygon = Polygon(Plane=construct_point, Radius=radius, Segments=number_of_vertices, FilletRadius=0)  # -> Polygon, Length
c_script = CSharpScript(pline=polygon.Polygon)  # -> out, points; inputs pline: Polyline
# ---------- c_script: C# ----------
    var pts = new List<Point3d>();

    pts = pline.ToList();

    points = pts;
# ---------- end c_script ----------
deconstruct = Deconstruct(Point=c_script.points)  # -> XComponent, YComponent, ZComponent
panel_5 = Panel(c_script.points)
# Obsolete
divide_curve = DivideCurve(Curve=polygon.Polygon, Count=number_of_vertices, Kinks=False)  # -> Points, Tangents, Parameters
entwine = Entwine(Branch00=deconstruct.XComponent, Branch01=deconstruct.YComponent, Branch02=deconstruct.ZComponent)
panel_6 = Panel(divide_curve.Points)
c_script_2 = CSharpScript(Path="D:\TEST", DataSet=entwine, Run=Toggle(True))  # -> out, A; inputs Path: String, DataSet: tree, Run: Boolean
# ---------- c_script_2: C# ----------
    if (Run)
    {
      List<List<string>> MyData = new List<List<string>>();

      for (int i = 0; i < DataSet.Branches.Count; i++)
      {
        List<string> tempList = new List<string>();

        foreach (var item in DataSet.Branches[i])
        {
          tempList.Add(item.ToString());
        }
        MyData.Add(tempList);
      }

      if (MyData != null && MyData.Count > 0 && Path != String.Empty)
      {
        using (var writer = new CsvFileWriter(Path + ".csv"))
        {
          // Write each row of data
          foreach (var myList in MyData)
          {
            writer.WriteRow(myList);
          }
        }
      }
    }
# ---------- c_script_2: C# additional code ----------
  /// <summary>
  /// Determines how empty lines are interpreted when reading CSV files.
  /// These values do not affect empty lines that occur within quoted fields
  /// or empty lines that appear at the end of the input file.
  /// </summary>
  public enum EmptyLineBehavior
  {
    /// <summary>
    /// Empty lines are interpreted as a line with zero columns.
    /// </summary>
    NoColumns,
    /// <summary>
    /// Empty lines are interpreted as a line with a single empty column.
    /// </summary>
    EmptyColumn,
    /// <summary>
    /// Empty lines are skipped over as though they did not exist.
    /// </summary>
    Ignore,
    /// <summary>
    /// An empty line is interpreted as the end of the input file.
    /// </summary>
    EndOfFile,
  }

  /// <summary>
  /// Common base class for CSV reader and writer classes.
  /// </summary>
  public abstract class CsvFileCommon
  {
    /// <summary>
    /// These are special characters in CSV files. If a column contains any
    /// of these characters, the entire column is wrapped in double quotes.
    /// </summary>
    protected char[] SpecialChars = new char[] { ',', '"', '\r', '\n' };

    // Indexes into SpecialChars for characters with specific meaning
    private const int DelimiterIndex = 0;
    private const int QuoteIndex = 1;

    /// <summary>
    /// Gets/sets the character used for column delimiters.
    /// </summary>
    public char Delimiter
    {
      get { return SpecialChars[DelimiterIndex]; }
      set { SpecialChars[DelimiterIndex] = value; }
    }

    /// <summary>
    /// Gets/sets the character used for column quotes.
    /// </summary>
    public char Quote
    {
      get { return SpecialChars[QuoteIndex]; }
      set { SpecialChars[QuoteIndex] = value; }
    }
  }

  /// <summary>
  /// Class for writing to comma-separated-value (CSV) files.
  /// </summary>
  public class CsvFileWriter : CsvFileCommon, IDisposable
  {
    // Private members
    private StreamWriter Writer;
    private string OneQuote = null;
    private string TwoQuotes = null;
    private string QuotedFormat = null;

    /// <summary>
    /// Initializes a new instance of the CsvFileWriter class for the
    /// specified stream.
    /// </summary>
    /// <param name="stream">The stream to write to</param>
    public CsvFileWriter(Stream stream)
    {
      Writer = new StreamWriter(stream);
    }

    /// <summary>
    /// Initializes a new instance of the CsvFileWriter class for the
    /// specified file path.
    /// </summary>
    /// <param name="path">The name of the CSV file to write to</param>
    public CsvFileWriter(string path)
    {
      Writer = new StreamWriter(path);
    }

    /// <summary>
    /// Writes a row of columns to the current CSV file.
    /// </summary>
    /// <param name="columns">The list of columns to write</param>
    public void WriteRow(List<string> columns)
    {
      // Verify required argument
      if (columns == null)
        throw new ArgumentNullException("columns");

      // Ensure we're using current quote character
      if (OneQuote == null || OneQuote[0] != Quote)
      {
        OneQuote = String.Format("{0}", Quote);
        TwoQuotes = String.Format("{0}{0}", Quote);
        QuotedFormat = String.Format("{0}{{0}}{0}", Quote);
      }

      // Write each column
      for (int i = 0; i < columns.Count; i++)
      {
        // Add delimiter if this isn't the first column
        if (i > 0)
          Writer.Write(Delimiter);
        // Write this column
        if (columns[i].IndexOfAny(SpecialChars) == -1)
          Writer.Write(columns[i]);
        else
          Writer.Write(QuotedFormat, columns[i].Replace(OneQuote, TwoQuotes));
      }
      Writer.WriteLine();
    }

    // Propagate Dispose to StreamWriter
    public void Dispose()
    {
      Writer.Dispose();
    }
  }
# ---------- end c_script_2 ----------
panel_7 = Panel(entwine)
