# Grasshopper definition Export  number To File.ghx (Grasshopper 0.9.64)

number_slider = Slider(4, range=0..10)
radius = Slider(5, range=1..10)
# The above panel streams to a file:
# 
# D:\pts.txt
# 
# You can change the path of the file in the Panel menu.
fillet = Slider(0, range=0..10)
pgon = Polygon(Plane=PlaneXY(0, 0, 0), Radius=radius, Segments=5, FilletRadius=fillet)  # -> Polygon, Length
# The F(x) component formats the incoming data using some advanced features of the Format() function.
div = DivideCurve(Curve=pgon.Polygon, Count=radius, Kinks=False)  # -> Points, Tangents, Parameters
c_script = CSharpScript(x=div.Points)  # -> out, A; inputs x: Point3d
# ---------- c_script: C# ----------
    string[] text = {"My test", "my test 2"};
    for (int i = 0; i < x; i++)
    {
      System.IO.File.WriteAllLines(@"D:\pts.txt", text);

    }
    A = text;
# ---------- end c_script ----------
panel = Panel(c_script.out)
f_x = F1(Function="Format(\"x = {0:0.00}      y = {1:0.00}\", p.x, p.y, p.z)", X=div.Points)
panel_2 = Panel(f_x)
