# Grasshopper definition write to file.ghx (Grasshopper 0.9.64)
# plug-ins: Python Interpreter

python_script = PythonScript(x=Slider(5, range=0..10))  # -> out, a
# ---------- python_script: Python ----------
file = open("D:/testfile.txt","w") 
 
file.write("Hello World") 
file.write("This is our new text file\n") 
file.write("and this is another line.") 
file.write("Why? Because we can.") 
 
file.close()
# ---------- end python_script ----------
panel = Panel(python_script.out)
panel_2 = Panel(python_script.a)
